# Grasshopper definition HyparToolsTest20211026-bug.gh (Grasshopper 1.0.7)
# plug-ins: HyparTools

srf = Surface()
negative_prototype = CSharpScript(
    InputHypar=srf,
    startNum=Slider(2, range=0..4),
    isSymmetric=Toggle(True),
    k1=Slider(1, range=0..5),
    angle1L=Slider(0, range=-1..1),
    angle2L=Slider(0, range=-1..1),
    k2=Slider(1, range=0..5),
    angle1R=Slider(0, range=-1..1),
    angle2R=Slider(0, range=-1..1),
    k3=Slider(1, range=0..5),
    angle3L=Slider(0, range=-1..1),
    angle4L=Slider(0, range=-1..1),
    k4=Slider(1, range=0..5),
    angle3R=Slider(0, range=-1..1),
    angle4R=Slider(0, range=-1..1))  # -> out, Hypar0, Hypar1, Hypar2, Hypar3, Hypar4, Hypar5; inputs InputHypar: Brep, startNum: Int32, isSymmetric: Boolean, k1: Double, angle1L: Double, angle2L: Double, k2: Double, angle1R: Double, angle2R: Double, k3: Double, angle3L: Double, angle4L: Double, k4: Double, angle3R: Double, angle4R: Double
# ---------- negative_prototype: C# usings ----------
using Rhino.DocObjects;
public class Hypar
{
  public Point P0;
  public Point P1;
  public Point P2;
  public Point P3;


  public Surface HyparSurface()
  {
    return NurbsSurface.CreateFromCorners(P0.Location, P1.Location, P2.Location, P3.Location);
  }
  public List<Vector3d> getVector()
  {
    List<Vector3d> vec = new List<Vector3d>();

    vec.Add((Vector3d) P1.Location - (Vector3d) P0.Location);
    vec.Add((Vector3d) P2.Location - (Vector3d) P1.Location);
    vec.Add((Vector3d) P3.Location - (Vector3d) P2.Location);
    vec.Add((Vector3d) P0.Location - (Vector3d) P3.Location);
    return vec;
  }
  public double[] getAngle()
  {
    double[] angle = new double[4];
    angle[0] = Vector3d.VectorAngle(this.getVector()[0], -this.getVector()[3]);
    angle[1] = Vector3d.VectorAngle(-this.getVector()[0], this.getVector()[1]);
    angle[2] = Vector3d.VectorAngle(-this.getVector()[1], this.getVector()[2]);
    angle[3] = Vector3d.VectorAngle(-this.getVector()[2], this.getVector()[3]);
    return angle;
  }
  public static Hypar HyparOrientation(Brep par_brep, int par_startNum)
  {
    Hypar hypar0 = new Hypar();
    if ((par_startNum % 4 + 4) % 4 == 0)
    {
      hypar0.P0 = par_brep.Vertices[0];
      hypar0.P1 = par_brep.Vertices[1];
      hypar0.P2 = par_brep.Vertices[2];
      hypar0.P3 = par_brep.Vertices[3];
    }
    else if ((par_startNum % 4 + 4) % 4 == 1)
    {
      hypar0.P0 = par_brep.Vertices[1];
      hypar0.P1 = par_brep.Vertices[2];
      hypar0.P2 = par_brep.Vertices[3];
      hypar0.P3 = par_brep.Vertices[0];
    }
    else if ((par_startNum % 4 + 4) % 4 == 2)
    {
      hypar0.P0 = par_brep.Vertices[2];
      hypar0.P1 = par_brep.Vertices[3];
      hypar0.P2 = par_brep.Vertices[0];
      hypar0.P3 = par_brep.Vertices[1];
    }
    else if ((par_startNum % 4 + 4) % 4 == 3)
    {
      hypar0.P0 = par_brep.Vertices[3];
      hypar0.P1 = par_brep.Vertices[0];
      hypar0.P2 = par_brep.Vertices[1];
      hypar0.P3 = par_brep.Vertices[2];
    }
    else hypar0 = null;
    return hypar0;
  }
  public static Hypar HyparGenerator(Hypar hypar0, double k, double angle1, double angle2)
  {
    Hypar hypar1 = new Hypar();
    double tri1_length01, tri1_length12, tri2_length32, tri2_length12;
    Vector3d tri1_vec, tri2_vec, vector12;
    // remap angle
    if (angle1 > 0)
      angle1 = angle1 * (Math.PI - hypar0.getAngle()[1]);
    else
      angle1 = angle1 * hypar0.getAngle()[1];

    if (angle2 > 0)
      angle2 = angle2 * hypar0.getAngle()[2];
    else
      angle2 = angle2 * (Math.PI - hypar0.getAngle()[2]);

    // solve triangle1
    tri1_length01 = k * hypar0.getVector()[0].Length;
    tri1_length12 = tri1_length01 * Math.Sin(angle1) / (Math.Sin(Math.PI - angle1 - hypar0.getAngle()[1]));
    vector12 = hypar0.getVector()[1];
    vector12.Unitize();
    tri1_vec = tri1_length12 * vector12;

    // solve triangle2
    tri2_length32 = k * hypar0.getVector()[2].Length;
    tri2_length12 = tri2_length32 * Math.Sin(angle2) / (Math.Sin(hypar0.getAngle()[2] - angle2));
    vector12 = hypar0.getVector()[1];
    vector12.Unitize();
    tri2_vec = tri2_length12 * vector12;

    //create hypar
    hypar1.P0 = hypar0.P1;
    hypar1.P1 = new Point(hypar0.P1.Location + (k * hypar0.getVector()[0] + tri1_vec));
    hypar1.P2 = new Point(hypar0.P2.Location - (k * hypar0.getVector()[2] - tri2_vec));
    hypar1.P3 = hypar0.P2;
    return hypar1;
  }

  /// <summary>
  /// Hypar generator in edge 12 with abusolute angle value in radius, no remap is included
  /// </summary>
  /// <param name="hypar0">hypar type</param>
  /// <param name="k">extend coefficient</param>
  /// <param name="angle1">angle in line01</param>
  /// <param name="angle2">angle in line32</param>
  /// <returns></returns>
  public static Hypar HyparGenerator_Absolute(Hypar hypar0, double k, double angle1, double angle2)
  {
    Hypar hypar1 = new Hypar();
    double tri1_length01, tri1_length12, tri2_length32, tri2_length12;
    Vector3d tri1_vec, tri2_vec, vector12;

    // solve triangle1
    tri1_length01 = k * hypar0.getVector()[0].Length;
    tri1_length12 = tri1_length01 * Math.Sin(angle1) / (Math.Sin(Math.PI - angle1 - hypar0.getAngle()[1]));
    vector12 = hypar0.getVector()[1];
    vector12.Unitize();
    tri1_vec = tri1_length12 * vector12;

    // solve triangle2
    tri2_length32 = k * hypar0.getVector()[2].Length;
    tri2_length12 = tri2_length32 * Math.Sin(angle2) / (Math.Sin(hypar0.getAngle()[2] - angle2));
    vector12 = hypar0.getVector()[1];
    vector12.Unitize();
    tri2_vec = tri2_length12 * vector12;

    //create hypar
    hypar1.P0 = hypar0.P1;
    hypar1.P1 = new Point(hypar0.P1.Location + (k * hypar0.getVector()[0] + tri1_vec));
    hypar1.P2 = new Point(hypar0.P2.Location - (k * hypar0.getVector()[2] - tri2_vec));
    hypar1.P3 = hypar0.P2;


    return hypar1;
  }
  public static Guid AddAngularDim(Point3d pM, Point3d pA, Point3d pB, string anno, double offset)
  {
    pA = pM + offset * (pA - pM) / (pA.DistanceTo(pM));
    pB = pM + offset * (pB - pM) / (pB.DistanceTo(pM));
    var dimstyle = new DimensionStyle();
    var dim = AngularDimension.Create(dimstyle, new Plane(pM, pA, pB), Vector3d.XAxis,
      pM,
      pA,
      pB,
      0.33 * (pM + pA + pB));
    dim.PlainText = anno;
    return Rhino.RhinoDoc.ActiveDoc.Objects.AddAngularDimension(dim);
  }
  /// <summary>
  /// Hypar generator in edge 23 with abusolute angle value in radius, no remap is included
  /// </summary>
  /// <param name="hypar0">hypar type</param>
  /// <param name="k">extend coefficient</param>
  /// <param name="angle1">angle in line01</param>
  /// <param name="angle2">angle in line32</param>
  /// <returns></returns>
  public static Hypar HyparGenRight_Absolute(Hypar hypar0, double k, double angle1, double angle2)
  {

    Hypar hypar = new Hypar();
    Hypar temphypar = new Hypar();
    hypar.P0 = hypar0.P1;
    hypar.P1 = hypar0.P2;
    hypar.P2 = hypar0.P3;
    hypar.P3 = hypar0.P0;
    temphypar = HyparGenerator_Absolute(hypar, k, -angle2, -angle1);
    hypar.P0 = temphypar.P3;
    hypar.P1 = temphypar.P0;
    hypar.P2 = temphypar.P1;
    hypar.P3 = temphypar.P2;
    return hypar;
  }

  public static Hypar HyparGenRight(Hypar hypar0, double k, double angle1, double angle2)
  {
    Hypar hypar = new Hypar();
    Hypar temphypar = new Hypar();
    hypar.P0 = hypar0.P1;
    hypar.P1 = hypar0.P2;
    hypar.P2 = hypar0.P3;
    hypar.P3 = hypar0.P0;
    temphypar = HyparGenerator(hypar, k, -angle2, -angle1);
    hypar.P0 = temphypar.P3;
    hypar.P1 = temphypar.P0;
    hypar.P2 = temphypar.P1;
    hypar.P3 = temphypar.P2;
    return hypar;
  }
  public static Hypar HyparGenMiddle(Hypar hyparLeft, Hypar hyparRight)
  {
    Hypar tar_Hypar = new Hypar();
    const double extendLength = 10000;
    Line hL23 = new Line(hyparLeft.P2.Location, hyparLeft.P3.Location);
    hL23.Extend(extendLength, extendLength);
    double disA = hL23.DistanceTo(hyparRight.P2.Location, false);
    double disB = hL23.DistanceTo(hyparLeft.P0.Location, false);

    Line hR12 = new Line(hyparRight.P1.Location, hyparRight.P2.Location);
    hR12.Extend(extendLength, extendLength);
    double disC = hR12.DistanceTo(hyparLeft.P2.Location, false);
    double disD = hR12.DistanceTo(hyparRight.P0.Location, false);

    Point pA = new Point(hyparLeft.P2.Location + (disA / disB) * hyparLeft.getVector()[1]);
    Point pB = new Point(hyparRight.P2.Location - (disC / disD) * hyparRight.getVector()[2]);
    Vector3d vecAB = new Vector3d((Vector3d) pB.Location - (Vector3d) pA.Location);

    Vector3d uvecAC = hyparLeft.getVector()[2];
    uvecAC.Unitize();
    Vector3d uvecBC = -hyparRight.getVector()[1];
    uvecBC.Unitize();

    Line lineAC = new Line(pA.Location, pA.Location + uvecAC);
    lineAC.Extend(extendLength, extendLength);
    Line lineBC = new Line(pB.Location, pB.Location + uvecBC);
    lineBC.Extend(extendLength, extendLength);
    double a, b;
    Rhino.Geometry.Intersect.Intersection.LineLine(lineAC, lineBC, out a, out b, 0.01, false);

    Point pCatAC = new Point(lineAC.PointAt(a));
    Point pCatBC = new Point(lineBC.PointAt(b));
    if (pCatAC.Location != pCatBC.Location)
    {
      // throw new ArgumentException("no intersection was found");
    }

            /*Rhino.RhinoDoc.ActiveDoc.Objects.AddPoint(pA.Location);
            Rhino.RhinoDoc.ActiveDoc.Objects.AddPoint(pB.Location);
            Rhino.RhinoDoc.ActiveDoc.Objects.AddPoint(pC.Location);
            Rhino.RhinoDoc.ActiveDoc.Objects.AddLine(lineAC);
            Rhino.RhinoDoc.ActiveDoc.Objects.AddLine(lineBC);*/

    tar_Hypar.P0 = hyparLeft.P3;
    tar_Hypar.P1 = hyparLeft.P2;
    tar_Hypar.P2 = pCatAC;
    tar_Hypar.P3 = hyparRight.P2;

    return tar_Hypar;
  }
}
# ---------- negative_prototype: C# ----------
    Hypar hypar0;
    Hypar hypar1 = new Hypar();
    Hypar hypar2 = new Hypar();
    Hypar hypar3 = new Hypar();
    Hypar hypar4 = new Hypar();
    Hypar hypar5 = new Hypar();

    
    // is symmetric
    if (isSymmetric == true)
    {
      k2 = k1;
      k4 = k3;
      angle1R = angle1L;
      angle2R = angle2L;
      angle3R = angle3L;
      angle4R = angle4L;
    }
    // hypar 0 generation
    Brep inputBrep = InputHypar;
    hypar0 = Hypar.HyparOrientation(inputBrep, startNum);

    //hypar 1 generation
    //angle2L remap
    angle2L = (angle2L - 1) * 0.5;
    hypar1 = Hypar.HyparGenerator(hypar0, k1, angle1L, angle2L);

    //hypar 2 generation
    //angle2R remap
    angle2R = (angle2R - 1) * 0.5;
    hypar2 = Hypar.HyparGenRight(hypar0, k2, angle1R, angle2R);

    //hypar 3 generation
    //angle4L remap
    if (angle4L >= 0)
      angle4L = ((angle4L - 1) * hypar0.getAngle()[2]) / (Math.PI - hypar1.getAngle()[3]);
    else
      angle4L = (angle4L * (Math.PI - hypar0.getAngle()[2] - hypar1.getAngle()[3]) - hypar0.getAngle()[2]) / (Math.PI - hypar1.getAngle()[3]);
    var hypartemp = new Hypar();
    hypartemp.P0 = hypar1.P1;
    hypartemp.P1 = hypar1.P2;
    hypartemp.P2 = hypar1.P3;
    hypartemp.P3 = hypar1.P0;
    hypartemp = Hypar.HyparGenerator(hypartemp, k3, angle3L, angle4L);
    hypar3.P0 = hypartemp.P3;
    hypar3.P1 = hypartemp.P0;
    hypar3.P2 = hypartemp.P1;
    hypar3.P3 = hypartemp.P2;

    //hypar 4  generation
    //angle 4R remap
    if (angle4R >= 0)
      angle4R = ((angle4R - 1) * hypar0.getAngle()[2]) / (Math.PI - hypar2.getAngle()[1]);
    else
      angle4R = (angle4R * (Math.PI - hypar0.getAngle()[2] - hypar2.getAngle()[1]) - hypar0.getAngle()[2]) / (Math.PI - hypar2.getAngle()[1]);
    hypar4 = Hypar.HyparGenerator(hypar2, k4, -angle4R, -angle3R);

    //hypar 5 generation
    var hyparLeft = new Hypar();
    hyparLeft.P0 = hypar3.P1;
    hyparLeft.P1 = hypar3.P2;
    hyparLeft.P2 = hypar3.P3;
    hyparLeft.P3 = hypar3.P0;

    var hyparRight = new Hypar();
    hyparRight.P0 = hypar4.P3;
    hyparRight.P1 = hypar4.P0;
    hyparRight.P2 = hypar4.P1;
    hyparRight.P3 = hypar4.P2;

    hypar5 = Hypar.HyparGenMiddle(hyparLeft, hyparRight);
            
    //set data
    
    Hypar0 = hypar0.HyparSurface();
    Hypar1 = hypar1.HyparSurface();
    Hypar2 = hypar2.HyparSurface();
    Hypar3 = hypar3.HyparSurface();
    Hypar4 = hypar4.HyparSurface();
    Hypar5 = hypar5.HyparSurface();
# ---------- end negative_prototype ----------

srf_2 = Surface()
positive_prototype = CSharpScript(
    InputHypar=srf_2,
    startNum=Slider(2, range=0..4),
    isSymmetric=Toggle(True),
    k1=Slider(1, range=0..5),
    angle1L=Slider(0, range=-1..1),
    angle2L=Slider(0, range=-1..1),
    k2=Slider(1, range=0..5),
    angle1R=Slider(0, range=-1..1),
    angle2R=Slider(0, range=-1..1))  # -> out, Hypar0, Hypar1, Hypar2, Hypar3; inputs InputHypar: Brep, startNum: Int32, isSymmetric: Boolean, k1: Double, angle1L: Double, angle2L: Double, k2: Double, angle1R: Double, angle2R: Double
# ---------- positive_prototype: C# ----------
    Hypar hypar0;
    Hypar hypar1 = new Hypar();
    Hypar hypar2 = new Hypar();
    Hypar hypar3 = new Hypar();


    // is symmetric
    if (isSymmetric == true)
    {
      k2 = k1;
      angle1R = angle1L;
      angle2R = angle2L;
    }

    //Brep to Surface
    Brep inputBrep = InputHypar;

    //Create Hypar in specific orientation
    hypar0 = Hypar.HyparOrientation(inputBrep, startNum);
    hypar1 = Hypar.HyparGenerator(hypar0, k1, angle1L, angle2L);
    hypar2 = Hypar.HyparGenRight(hypar0, k2, angle1R, angle2R);
    hypar3 = Hypar.HyparGenMiddle(hypar1, hypar2);
    //set data
    Hypar0 = hypar0.HyparSurface();
    Hypar1 = hypar1.HyparSurface();
    Hypar2 = hypar2.HyparSurface();
    Hypar3 = hypar3.HyparSurface();
# ---------- end positive_prototype ----------

# ----
# standalone C# script
number_slider = Slider(0, range=-1..1)
srf_3 = Surface()
c_script = CSharpScript(
    InputHypar=srf_3,
    startNum=Slider(0, range=0..4),
    k1=Slider(1, range=0..5),
    angle1L=Slider(0, range=-1..1),
    angle2L=number_slider)  # -> out, OutputHypar; inputs InputHypar: Brep, startNum: Int32, k1: Double, angle1L: Double, angle2L: Double
# ---------- c_script: C# usings ----------
using Rhino.DocObjects;

public class Hypar
{
  public Point P0;
  public Point P1;
  public Point P2;
  public Point P3;


  public Surface HyparSurface()
  {
    return NurbsSurface.CreateFromCorners(P0.Location, P1.Location, P2.Location, P3.Location);
  }
  public List<Vector3d> getVector()
  {
    List<Vector3d> vec = new List<Vector3d>();

    vec.Add((Vector3d) P1.Location - (Vector3d) P0.Location);
    vec.Add((Vector3d) P2.Location - (Vector3d) P1.Location);
    vec.Add((Vector3d) P3.Location - (Vector3d) P2.Location);
    vec.Add((Vector3d) P0.Location - (Vector3d) P3.Location);
    return vec;
  }
  public double[] getAngle()
  {
    double[] angle = new double[4];
    angle[0] = Vector3d.VectorAngle(this.getVector()[0], -this.getVector()[3]);
    angle[1] = Vector3d.VectorAngle(-this.getVector()[0], this.getVector()[1]);
    angle[2] = Vector3d.VectorAngle(-this.getVector()[1], this.getVector()[2]);
    angle[3] = Vector3d.VectorAngle(-this.getVector()[2], this.getVector()[3]);
    return angle;
  }
  public static Hypar HyparOrientation(Brep par_brep, int par_startNum)
  {
    Hypar hypar0 = new Hypar();
    if ((par_startNum % 4 + 4) % 4 == 0)
    {
      hypar0.P0 = par_brep.Vertices[0];
      hypar0.P1 = par_brep.Vertices[1];
      hypar0.P2 = par_brep.Vertices[2];
      hypar0.P3 = par_brep.Vertices[3];
    }
    else if ((par_startNum % 4 + 4) % 4 == 1)
    {
      hypar0.P0 = par_brep.Vertices[1];
      hypar0.P1 = par_brep.Vertices[2];
      hypar0.P2 = par_brep.Vertices[3];
      hypar0.P3 = par_brep.Vertices[0];
    }
    else if ((par_startNum % 4 + 4) % 4 == 2)
    {
      hypar0.P0 = par_brep.Vertices[2];
      hypar0.P1 = par_brep.Vertices[3];
      hypar0.P2 = par_brep.Vertices[0];
      hypar0.P3 = par_brep.Vertices[1];
    }
    else if ((par_startNum % 4 + 4) % 4 == 3)
    {
      hypar0.P0 = par_brep.Vertices[3];
      hypar0.P1 = par_brep.Vertices[0];
      hypar0.P2 = par_brep.Vertices[1];
      hypar0.P3 = par_brep.Vertices[2];
    }
    else hypar0 = null;
    return hypar0;
  }
  public static Hypar HyparGenerator(Hypar hypar0, double k, double angle1, double angle2)
  {
    Hypar hypar1 = new Hypar();
    double tri1_length01, tri1_length12, tri2_length32, tri2_length12;
    Vector3d tri1_vec, tri2_vec, vector12;
    // remap angle
    if (angle1 > 0)
      angle1 = angle1 * (Math.PI - hypar0.getAngle()[1]);
    else
      angle1 = angle1 * hypar0.getAngle()[1];

    if (angle2 > 0)
      angle2 = angle2 * hypar0.getAngle()[2];
    else
      angle2 = angle2 * (Math.PI - hypar0.getAngle()[2]);

    // solve triangle1
    tri1_length01 = k * hypar0.getVector()[0].Length;
    tri1_length12 = tri1_length01 * Math.Sin(angle1) / (Math.Sin(Math.PI - angle1 - hypar0.getAngle()[1]));
    vector12 = hypar0.getVector()[1];
    vector12.Unitize();
    tri1_vec = tri1_length12 * vector12;

    // solve triangle2
    tri2_length32 = k * hypar0.getVector()[2].Length;
    tri2_length12 = tri2_length32 * Math.Sin(angle2) / (Math.Sin(hypar0.getAngle()[2] - angle2));
    vector12 = hypar0.getVector()[1];
    vector12.Unitize();
    tri2_vec = tri2_length12 * vector12;

    //create hypar
    hypar1.P0 = hypar0.P1;
    hypar1.P1 = new Point(hypar0.P1.Location + (k * hypar0.getVector()[0] + tri1_vec));
    hypar1.P2 = new Point(hypar0.P2.Location - (k * hypar0.getVector()[2] - tri2_vec));
    hypar1.P3 = hypar0.P2;
    return hypar1;
  }

  /// <summary>
  /// Hypar generator in edge 12 with abusolute angle value in radius, no remap is included
  /// </summary>
  /// <param name="hypar0">hypar type</param>
  /// <param name="k">extend coefficient</param>
  /// <param name="angle1">angle in line01</param>
  /// <param name="angle2">angle in line32</param>
  /// <returns></returns>
  public static Hypar HyparGenerator_Absolute(Hypar hypar0, double k, double angle1, double angle2)
  {
    Hypar hypar1 = new Hypar();
    double tri1_length01, tri1_length12, tri2_length32, tri2_length12;
    Vector3d tri1_vec, tri2_vec, vector12;

    // solve triangle1
    tri1_length01 = k * hypar0.getVector()[0].Length;
    tri1_length12 = tri1_length01 * Math.Sin(angle1) / (Math.Sin(Math.PI - angle1 - hypar0.getAngle()[1]));
    vector12 = hypar0.getVector()[1];
    vector12.Unitize();
    tri1_vec = tri1_length12 * vector12;

    // solve triangle2
    tri2_length32 = k * hypar0.getVector()[2].Length;
    tri2_length12 = tri2_length32 * Math.Sin(angle2) / (Math.Sin(hypar0.getAngle()[2] - angle2));
    vector12 = hypar0.getVector()[1];
    vector12.Unitize();
    tri2_vec = tri2_length12 * vector12;

    //create hypar
    hypar1.P0 = hypar0.P1;
    hypar1.P1 = new Point(hypar0.P1.Location + (k * hypar0.getVector()[0] + tri1_vec));
    hypar1.P2 = new Point(hypar0.P2.Location - (k * hypar0.getVector()[2] - tri2_vec));
    hypar1.P3 = hypar0.P2;


    return hypar1;
  }
  public static Guid AddAngularDim(Point3d pM, Point3d pA, Point3d pB, string anno, double offset)
  {
    pA = pM + offset * (pA - pM) / (pA.DistanceTo(pM));
    pB = pM + offset * (pB - pM) / (pB.DistanceTo(pM));
    var dimstyle = new DimensionStyle();
    var dim = AngularDimension.Create(dimstyle, new Plane(pM, pA, pB), Vector3d.XAxis,
      pM,
      pA,
      pB,
      0.33 * (pM + pA + pB));
    dim.PlainText = anno;
    return Rhino.RhinoDoc.ActiveDoc.Objects.AddAngularDimension(dim);
  }
  /// <summary>
  /// Hypar generator in edge 23 with abusolute angle value in radius, no remap is included
  /// </summary>
  /// <param name="hypar0">hypar type</param>
  /// <param name="k">extend coefficient</param>
  /// <param name="angle1">angle in line01</param>
  /// <param name="angle2">angle in line32</param>
  /// <returns></returns>
  public static Hypar HyparGenRight_Absolute(Hypar hypar0, double k, double angle1, double angle2)
  {

    Hypar hypar = new Hypar();
    Hypar temphypar = new Hypar();
    hypar.P0 = hypar0.P1;
    hypar.P1 = hypar0.P2;
    hypar.P2 = hypar0.P3;
    hypar.P3 = hypar0.P0;
    temphypar = HyparGenerator_Absolute(hypar, k, -angle2, -angle1);
    hypar.P0 = temphypar.P3;
    hypar.P1 = temphypar.P0;
    hypar.P2 = temphypar.P1;
    hypar.P3 = temphypar.P2;
    return hypar;
  }

  public static Hypar HyparGenRight(Hypar hypar0, double k, double angle1, double angle2)
  {
    Hypar hypar = new Hypar();
    Hypar temphypar = new Hypar();
    hypar.P0 = hypar0.P1;
    hypar.P1 = hypar0.P2;
    hypar.P2 = hypar0.P3;
    hypar.P3 = hypar0.P0;
    temphypar = HyparGenerator(hypar, k, -angle2, -angle1);
    hypar.P0 = temphypar.P3;
    hypar.P1 = temphypar.P0;
    hypar.P2 = temphypar.P1;
    hypar.P3 = temphypar.P2;
    return hypar;
  }
  public static Hypar HyparGenMiddle(Hypar hyparLeft, Hypar hyparRight)
  {
    Hypar tar_Hypar = new Hypar();
    const double extendLength = 10000;
    Line hL23 = new Line(hyparLeft.P2.Location, hyparLeft.P3.Location);
    hL23.Extend(extendLength, extendLength);
    double disA = hL23.DistanceTo(hyparRight.P2.Location, false);
    double disB = hL23.DistanceTo(hyparLeft.P0.Location, false);

    Line hR12 = new Line(hyparRight.P1.Location, hyparRight.P2.Location);
    hR12.Extend(extendLength, extendLength);
    double disC = hR12.DistanceTo(hyparLeft.P2.Location, false);
    double disD = hR12.DistanceTo(hyparRight.P0.Location, false);

    Point pA = new Point(hyparLeft.P2.Location + (disA / disB) * hyparLeft.getVector()[1]);
    Point pB = new Point(hyparRight.P2.Location - (disC / disD) * hyparRight.getVector()[2]);
    Vector3d vecAB = new Vector3d((Vector3d) pB.Location - (Vector3d) pA.Location);

    Vector3d uvecAC = hyparLeft.getVector()[2];
    uvecAC.Unitize();
    Vector3d uvecBC = -hyparRight.getVector()[1];
    uvecBC.Unitize();

    Line lineAC = new Line(pA.Location, pA.Location + uvecAC);
    lineAC.Extend(extendLength, extendLength);
    Line lineBC = new Line(pB.Location, pB.Location + uvecBC);
    lineBC.Extend(extendLength, extendLength);
    double a, b;
    Rhino.Geometry.Intersect.Intersection.LineLine(lineAC, lineBC, out a, out b, 0.01, false);

    Point pCatAC = new Point(lineAC.PointAt(a));
    Point pCatBC = new Point(lineBC.PointAt(b));
    if (pCatAC.Location != pCatBC.Location)
    {
      // throw new ArgumentException("no intersection was found");
    }

            /*Rhino.RhinoDoc.ActiveDoc.Objects.AddPoint(pA.Location);
            Rhino.RhinoDoc.ActiveDoc.Objects.AddPoint(pB.Location);
            Rhino.RhinoDoc.ActiveDoc.Objects.AddPoint(pC.Location);
            Rhino.RhinoDoc.ActiveDoc.Objects.AddLine(lineAC);
            Rhino.RhinoDoc.ActiveDoc.Objects.AddLine(lineBC);*/

    tar_Hypar.P0 = hyparLeft.P3;
    tar_Hypar.P1 = hyparLeft.P2;
    tar_Hypar.P2 = pCatAC;
    tar_Hypar.P3 = hyparRight.P2;

    return tar_Hypar;
  }
}
# ---------- c_script: C# ----------
    Hypar hypar0;
    Hypar hypar1 = new Hypar();

    Brep inputBrep = InputHypar;
    //Create Hypar in specific orientation
    hypar0 = Hypar.HyparOrientation(inputBrep, startNum);
    hypar1 = Hypar.HyparGenerator(hypar0, k1, angle1L, angle2L);

            /*Guid guid_now = new Guid();
            Rhino.RhinoDoc.ActiveDoc.Objects.Delete(guid_now, true);
            var dimstyle = new DimensionStyle();
            var dim1 = AngularDimension.Create(dimstyle, Plane.WorldXY, new Vector3d(k1, 0, 0), new Point3d(0, 0, 0), new Point3d(0, 10, 0), new Point3d(10, 0, 0), new Point3d(10, 10, 0));
            guid_now = Rhino.RhinoDoc.ActiveDoc.Objects.AddAngularDimension(dim1);*/

            /*var func_info = Rhino.NodeInCode.Components.FindComponent("AngularDimension");
            if (func_info == null) { throw new ArgumentException("nothing"); }
            var func = func_info.Delegate as dynamic;
            func(new Point3d(0,0,0), new Point3d(0, 1, 0), new Point3d(1, 0, 0),false,"111",10);*/

            //set data
    OutputHypar = hypar1.HyparSurface();
# ---------- end c_script ----------

srf_4 = Surface()
srf_5 = Surface()
negative_side = CSharpScript(
    InputHypar1=srf_4,
    InputHypar2=srf_5,
    k1=Slider(1, range=0..5),
    angle1L=Slider(-0.201, range=-1..1),
    angle2L=Slider(-0.135, range=-1..1))  # -> out, Hypar1, Hypar2, Hypar3, Hypar4; inputs InputHypar1: Brep, InputHypar2: Brep, k1: Double, angle1L: Double, angle2L: Double
# ---------- negative_side: C# usings ----------
using Rhino.DocObjects;
public class Hypar
{
  public Point P0;
  public Point P1;
  public Point P2;
  public Point P3;

        
  public Surface HyparSurface()
  {
    return NurbsSurface.CreateFromCorners(P0.Location, P1.Location, P2.Location, P3.Location);
  }
  public List<Vector3d> getVector()
  {
    List<Vector3d> vec = new List<Vector3d>();

    vec.Add((Vector3d) P1.Location - (Vector3d) P0.Location);
    vec.Add((Vector3d) P2.Location - (Vector3d) P1.Location);
    vec.Add((Vector3d) P3.Location - (Vector3d) P2.Location);
    vec.Add((Vector3d) P0.Location - (Vector3d) P3.Location);
    return vec;
  }
  public double[] getAngle()
  {
    double[] angle = new double[4];
    angle[0] = Vector3d.VectorAngle(this.getVector()[0], -this.getVector()[3]);
    angle[1] = Vector3d.VectorAngle(-this.getVector()[0], this.getVector()[1]);
    angle[2] = Vector3d.VectorAngle(-this.getVector()[1], this.getVector()[2]);
    angle[3] = Vector3d.VectorAngle(-this.getVector()[2], this.getVector()[3]);
    return angle;
  }
  public static Hypar HyparOrientation(Brep par_brep, int par_startNum)
  {
    Hypar hypar0 = new Hypar();
    if ((par_startNum % 4 + 4) % 4 == 0)
    {
      hypar0.P0 = par_brep.Vertices[0];
      hypar0.P1 = par_brep.Vertices[1];
      hypar0.P2 = par_brep.Vertices[2];
      hypar0.P3 = par_brep.Vertices[3];
    }
    else if ((par_startNum % 4 + 4) % 4 == 1)
    {
      hypar0.P0 = par_brep.Vertices[1];
      hypar0.P1 = par_brep.Vertices[2];
      hypar0.P2 = par_brep.Vertices[3];
      hypar0.P3 = par_brep.Vertices[0];
    }
    else if ((par_startNum % 4 + 4) % 4 == 2)
    {
      hypar0.P0 = par_brep.Vertices[2];
      hypar0.P1 = par_brep.Vertices[3];
      hypar0.P2 = par_brep.Vertices[0];
      hypar0.P3 = par_brep.Vertices[1];
    }
    else if ((par_startNum % 4 + 4) % 4 == 3)
    {
      hypar0.P0 = par_brep.Vertices[3];
      hypar0.P1 = par_brep.Vertices[0];
      hypar0.P2 = par_brep.Vertices[1];
      hypar0.P3 = par_brep.Vertices[2];
    }
    else hypar0 = null;
    return hypar0;
  }
  public static Hypar HyparOrientation(Hypar par_hypar, int par_startNum)
  {
    Hypar hypar0 = new Hypar();
    if ((par_startNum % 4 + 4) % 4 == 0)
    {
      hypar0.P0 = par_hypar.P0;
      hypar0.P1 = par_hypar.P1;
      hypar0.P2 = par_hypar.P2;
      hypar0.P3 = par_hypar.P3;
    }
    else if ((par_startNum % 4 + 4) % 4 == 1)
    {
      hypar0.P0 = par_hypar.P1;
      hypar0.P1 = par_hypar.P2;
      hypar0.P2 = par_hypar.P3;
      hypar0.P3 = par_hypar.P0;
    }
    else if ((par_startNum % 4 + 4) % 4 == 2)
    {
      hypar0.P0 = par_hypar.P2;
      hypar0.P1 = par_hypar.P3;
      hypar0.P2 = par_hypar.P0;
      hypar0.P3 = par_hypar.P1;
    }
    else if ((par_startNum % 4 + 4) % 4 == 3)
    {
      hypar0.P0 = par_hypar.P3;
      hypar0.P1 = par_hypar.P0;
      hypar0.P2 = par_hypar.P1;
      hypar0.P3 = par_hypar.P2;
    }
    else hypar0 = null;
    return hypar0;
  }
  public static Hypar HyparGenerator(Hypar hypar0, double k, double angle1, double angle2)
  {
    Hypar hypar1 = new Hypar();
    double tri1_length01, tri1_length12, tri2_length32, tri2_length12;
    Vector3d tri1_vec, tri2_vec, vector12;
    // remap angle
    if (angle1 > 0)
      angle1 = angle1 * (Math.PI - hypar0.getAngle()[1]);
    else
      angle1 = angle1 * hypar0.getAngle()[1];

    if (angle2 > 0)
      angle2 = angle2 * hypar0.getAngle()[2];
    else
      angle2 = angle2 * (Math.PI - hypar0.getAngle()[2]);

    // solve triangle1
    tri1_length01 = k * hypar0.getVector()[0].Length;
    tri1_length12 = tri1_length01 * Math.Sin(angle1) / (Math.Sin(Math.PI - angle1 - hypar0.getAngle()[1]));
    vector12 = hypar0.getVector()[1];
    vector12.Unitize();
    tri1_vec = tri1_length12 * vector12;

    // solve triangle2
    tri2_length32 = k * hypar0.getVector()[2].Length;
    tri2_length12 = tri2_length32 * Math.Sin(angle2) / (Math.Sin(hypar0.getAngle()[2] - angle2));
    vector12 = hypar0.getVector()[1];
    vector12.Unitize();
    tri2_vec = tri2_length12 * vector12;

    //create hypar
    hypar1.P0 = hypar0.P1;
    hypar1.P1 = new Point(hypar0.P1.Location + (k * hypar0.getVector()[0] + tri1_vec));
    hypar1.P2 = new Point(hypar0.P2.Location - (k * hypar0.getVector()[2] - tri2_vec));
    hypar1.P3 = hypar0.P2;
    return hypar1;
  }

  /// <summary>
  /// Hypar generator in edge 12 with abusolute angle value in radius, no remap is included
  /// </summary>
  /// <param name="hypar0">hypar type</param>
  /// <param name="k">extend coefficient</param>
  /// <param name="angle1">angle in line01</param>
  /// <param name="angle2">angle in line32</param>
  /// <returns></returns>
  public static Hypar HyparGenerator_Absolute(Hypar hypar0, double k, double angle1, double angle2)
  {
    Hypar hypar1 = new Hypar();
    double tri1_length01, tri1_length12, tri2_length32, tri2_length12;
    Vector3d tri1_vec, tri2_vec, vector12;

    // solve triangle1
    tri1_length01 = k * hypar0.getVector()[0].Length;
    tri1_length12 = tri1_length01 * Math.Sin(angle1) / (Math.Sin(Math.PI - angle1 - hypar0.getAngle()[1]));
    vector12 = hypar0.getVector()[1];
    vector12.Unitize();
    tri1_vec = tri1_length12 * vector12;

    // solve triangle2
    tri2_length32 = k * hypar0.getVector()[2].Length;
    tri2_length12 = tri2_length32 * Math.Sin(angle2) / (Math.Sin(hypar0.getAngle()[2] - angle2));
    vector12 = hypar0.getVector()[1];
    vector12.Unitize();
    tri2_vec = tri2_length12 * vector12;

    //create hypar
    hypar1.P0 = hypar0.P1;
    hypar1.P1 = new Point(hypar0.P1.Location + (k * hypar0.getVector()[0] + tri1_vec));
    hypar1.P2 = new Point(hypar0.P2.Location - (k * hypar0.getVector()[2] - tri2_vec));
    hypar1.P3 = hypar0.P2;

            
    return hypar1;
  }
  public static Guid AddAngularDim(Point3d pM, Point3d pA, Point3d pB, string anno, double offset)
  {
    pA = pM + offset * (pA - pM) / (pA.DistanceTo(pM));
    pB = pM + offset * (pB - pM) / (pB.DistanceTo(pM));
    var dimstyle = new DimensionStyle();
    var dim = AngularDimension.Create(dimstyle, new Plane(pM, pA, pB), Vector3d.XAxis,
      pM,
      pA,
      pB,
      0.33 * (pM + pA + pB));
    dim.PlainText = anno;
    return Rhino.RhinoDoc.ActiveDoc.Objects.AddAngularDimension(dim);
  }
  /// <summary>
  /// Hypar generator in edge 23 with abusolute angle value in radius, no remap is included
  /// </summary>
  /// <param name="hypar0">hypar type</param>
  /// <param name="k">extend coefficient</param>
  /// <param name="angle1">angle in line01</param>
  /// <param name="angle2">angle in line32</param>
  /// <returns></returns>
  public static Hypar HyparGenRight_Absolute(Hypar hypar0, double k, double angle1, double angle2)
  {
            
    Hypar hypar = new Hypar();
    Hypar temphypar = new Hypar();
    hypar.P0 = hypar0.P1;
    hypar.P1 = hypar0.P2;
    hypar.P2 = hypar0.P3;
    hypar.P3 = hypar0.P0;
    temphypar = HyparGenerator_Absolute(hypar, k, -angle2, -angle1);
    hypar.P0 = temphypar.P3;
    hypar.P1 = temphypar.P0;
    hypar.P2 = temphypar.P1;
    hypar.P3 = temphypar.P2;
    return hypar;
  }

  public static Hypar HyparGenRight(Hypar hypar0, double k, double angle1, double angle2)
  {
    Hypar hypar = new Hypar();
    Hypar temphypar = new Hypar();
    hypar.P0 = hypar0.P1;
    hypar.P1 = hypar0.P2;
    hypar.P2 = hypar0.P3;
    hypar.P3 = hypar0.P0;
    temphypar = HyparGenerator(hypar, k, -angle2, -angle1);
    hypar.P0 = temphypar.P3;
    hypar.P1 = temphypar.P0;
    hypar.P2 = temphypar.P1;
    hypar.P3 = temphypar.P2;
    return hypar;
  }
  public static Hypar HyparGenMiddle(Hypar hyparLeft, Hypar hyparRight)
  {
    Hypar tar_Hypar = new Hypar();
    const double extendLength = 10000;
    Line hL23 = new Line(hyparLeft.P2.Location, hyparLeft.P3.Location);
    hL23.Extend(extendLength, extendLength);
    double disA = hL23.DistanceTo(hyparRight.P2.Location, false);
    double disB = hL23.DistanceTo(hyparLeft.P0.Location, false);

    Line hR12 = new Line(hyparRight.P1.Location, hyparRight.P2.Location);
    hR12.Extend(extendLength, extendLength);
    double disC = hR12.DistanceTo(hyparLeft.P2.Location, false);
    double disD = hR12.DistanceTo(hyparRight.P0.Location, false);

    Point pA = new Point(hyparLeft.P2.Location + (disA / disB) * hyparLeft.getVector()[1]);
    Point pB = new Point(hyparRight.P2.Location - (disC / disD) * hyparRight.getVector()[2]);
    Vector3d vecAB = new Vector3d((Vector3d) pB.Location - (Vector3d) pA.Location);

    Vector3d uvecAC = hyparLeft.getVector()[2];
    uvecAC.Unitize();
    Vector3d uvecBC = -hyparRight.getVector()[1];
    uvecBC.Unitize();

    Line lineAC = new Line(pA.Location, pA.Location + uvecAC);
    lineAC.Extend(extendLength, extendLength);
    Line lineBC = new Line(pB.Location, pB.Location + uvecBC);
    lineBC.Extend(extendLength, extendLength);
    double a, b;
    Rhino.Geometry.Intersect.Intersection.LineLine(lineAC, lineBC, out a, out b, 0.01, false);

    Point pCatAC = new Point(lineAC.PointAt(a));
    Point pCatBC = new Point(lineBC.PointAt(b));
    if (pCatAC.Location != pCatBC.Location)
    { 
      // throw new ArgumentException("no intersection was found"); 
    }

            /*Rhino.RhinoDoc.ActiveDoc.Objects.AddPoint(pA.Location);
            Rhino.RhinoDoc.ActiveDoc.Objects.AddPoint(pB.Location);
            Rhino.RhinoDoc.ActiveDoc.Objects.AddPoint(pC.Location);
            Rhino.RhinoDoc.ActiveDoc.Objects.AddLine(lineAC);
            Rhino.RhinoDoc.ActiveDoc.Objects.AddLine(lineBC);*/

    tar_Hypar.P0 = hyparLeft.P3;
    tar_Hypar.P1 = hyparLeft.P2;
    tar_Hypar.P2 = pCatAC;
    tar_Hypar.P3 = hyparRight.P2;

    return tar_Hypar;
  }
}
# ---------- negative_side: C# ----------
    //get hypar data

    Brep inputBrep1 = InputHypar1;
    Brep inputBrep2 = InputHypar2;
    Hypar hyparLeft = Hypar.HyparOrientation(inputBrep1, 0);
    Hypar hyparRight = Hypar.HyparOrientation(inputBrep2, 0);

    //convert hypars to point3d type
    List<Point3d> hL = new List<Point3d>();
    hL.Add(hyparLeft.P0.Location);
    hL.Add(hyparLeft.P1.Location);
    hL.Add(hyparLeft.P2.Location);
    hL.Add(hyparLeft.P3.Location);

    List<Point3d> hR = new List<Point3d>();
    hR.Add(hyparRight.P0.Location);
    hR.Add(hyparRight.P1.Location);
    hR.Add(hyparRight.P2.Location);
    hR.Add(hyparRight.P3.Location);

    //remap point sequence
    var hyparLeft1 = new Hypar();
    var hyparRight1 = new Hypar();
    var hyparLeft2 = new Hypar();
    var hyparRight2 = new Hypar();



    var hL03 = new Vector3d();
    var hL32 = new Vector3d();
    var hR01 = new Vector3d();
    var hR12 = new Vector3d();

    //判断顺逆时针并调整
    for (int p = 0; p <= 3; p++)
    {
      for (int q = 0; q <= 3; q++)
      {
        if (hL[p].Equals(hR[q]))
        {

          //编号顺逆时针判断
          hL03 = (Vector3d) hL[(p % 4 + 4) % 4] - (Vector3d) hL[((p + 1) % 4 + 4) % 4];
          hL32 = (Vector3d) hL[((p - 1) % 4 + 4) % 4] - (Vector3d) hL[(p % 4 + 4) % 4];

          hR01 = (Vector3d) hR[(q % 4 + 4) % 4] - (Vector3d) hR[((q - 1) % 4 + 4) % 4];
          hR12 = (Vector3d) hR[((q + 1) % 4 + 4) % 4] - (Vector3d) hR[(q % 4 + 4) % 4];
          if (Vector3d.Multiply(Vector3d.CrossProduct(hL03, hL32), Vector3d.CrossProduct(hR01, hR12)) > 0)
          {
            hyparLeft.P1 = new Point(hL[3]);
            hyparLeft.P3 = new Point(hL[1]);
          }
        }
      }
    }
    for (int i = 0; i <= 3; i++)
    {
      for (int j = 0; j <= 3; j++)
      {
        if (hL[i].Equals(hR[j]))//公共点判断
        {
          //side a
          hyparLeft1 = Hypar.HyparOrientation(hyparLeft, i - 3);
          hyparRight1 = Hypar.HyparOrientation(hyparRight, j - 1);
          //side b
          hyparLeft2 = Hypar.HyparOrientation(hyparLeft, i - 1);
          hyparRight2 = Hypar.HyparOrientation(hyparRight, j + 1);
          break;
        }
      }
    }

    //remap angle
    // 1. 求三角形中线夹角
    Vector3d vec32 = -hyparLeft1.getVector()[2];
    Vector3d vec12 = hyparRight1.getVector()[1];
    Vector3d vecM = vec32 + vec12;
    double angleM = Vector3d.VectorAngle(vec32, vecM); //中线与一边的夹角
    double angleA = Vector3d.VectorAngle(vec32, vec12); //两边的夹角
    // remap angle
    if (angle1L > 0)
      angle1L = angle1L * angleM + (Math.PI - hyparLeft1.getAngle()[3] - angleM);
    else
      angle1L = angle1L * (angleA - angleM) + (Math.PI - hyparLeft1.getAngle()[3] - angleM);

    if (angle2L > 0)
      angle2L = angle2L * hyparRight1.getAngle()[2];
    else
      angle2L = angle2L * (Math.PI - hyparRight1.getAngle()[2]);




    var hypar1 = Hypar.HyparGenRight_Absolute(hyparLeft1, k1, angle1L, angle2L);
    var hypartemp = new Hypar();
    hypartemp.P0 = hypar1.P1;
    hypartemp.P1 = hypar1.P2;
    hypartemp.P2 = hypar1.P3;
    hypartemp.P3 = hypar1.P0;

    var hypar2 = Hypar.HyparGenMiddle(hypartemp, hyparRight1);


    var hypar3 = Hypar.HyparGenerator_Absolute(hyparLeft2, k1, angle1L, angle2L);
    var hypartemp2 = new Hypar();
    hypartemp2.P0 = hypar3.P3;
    hypartemp2.P1 = hypar3.P0;
    hypartemp2.P2 = hypar3.P1;
    hypartemp2.P3 = hypar3.P2;
    var hypar4 = Hypar.HyparGenMiddle(hyparRight2, hypartemp2);
            /*
            //create angular dimension
            var temp_1 = Hypar.AddAngularDim(hyparLeft1.P3.Location,
                 hypar1.P3.Location,
                 hyparLeft1.P3.Location - hyparLeft1.getVector()[3],
                 "angle1L=\r\n<>",
                 2000);

            var temp_2 = Hypar.AddAngularDim(hyparLeft1.P2.Location,
                hyparLeft1.P2.Location + hyparLeft1.getVector()[1],
                hypar1.P2.Location,
                "angle2L=\r\n<>",
                2000);

            //删除标注
            Rhino.RhinoDoc.ActiveDoc.Objects.Delete(Temp1, true);
            Temp1 = temp_1;
            Rhino.RhinoDoc.ActiveDoc.Objects.Delete(Temp2,true);
            Temp2 = temp_2;
            */
            //set data

    Hypar1 = hypar1.HyparSurface();
    Hypar2 = hypar2.HyparSurface();
    Hypar3 = hypar3.HyparSurface();
    Hypar4 = hypar4.HyparSurface();
# ---------- end negative_side ----------

# ----
# 0926更新
srf_6 = Surface(<surface referenced from the Rhino model>)
srf_7 = Surface(<surface referenced from the Rhino model>)
positive_side = CSharpScript(
    InputHypar1=srf_6,
    InputHypar2=srf_7,
    Reference="D:\OneDrive\Design\CAUP 硕士第五学期\Hypar Project\HyparTools\HyparTools\bin\MathNet.Numerics.dll")  # -> out, Hypar1; inputs InputHypar1: Brep, InputHypar2: Brep
# ---------- positive_side: C# usings ----------
using Rhino.DocObjects;

public class Hypar
{
  public Point P0;
  public Point P1;
  public Point P2;
  public Point P3;


  public Surface HyparSurface()
  {
    return NurbsSurface.CreateFromCorners(P0.Location, P1.Location, P2.Location, P3.Location);
  }
  public List<Vector3d> getVector()
  {
    List<Vector3d> vec = new List<Vector3d>();

    vec.Add((Vector3d) P1.Location - (Vector3d) P0.Location);
    vec.Add((Vector3d) P2.Location - (Vector3d) P1.Location);
    vec.Add((Vector3d) P3.Location - (Vector3d) P2.Location);
    vec.Add((Vector3d) P0.Location - (Vector3d) P3.Location);
    return vec;
  }
  public double[] getAngle()
  {
    double[] angle = new double[4];
    angle[0] = Vector3d.VectorAngle(this.getVector()[0], -this.getVector()[3]);
    angle[1] = Vector3d.VectorAngle(-this.getVector()[0], this.getVector()[1]);
    angle[2] = Vector3d.VectorAngle(-this.getVector()[1], this.getVector()[2]);
    angle[3] = Vector3d.VectorAngle(-this.getVector()[2], this.getVector()[3]);
    return angle;
  }
  public static Hypar HyparOrientation(Brep par_brep, int par_startNum)
  {
    Hypar hypar0 = new Hypar();
    if ((par_startNum % 4 + 4) % 4 == 0)
    {
      hypar0.P0 = par_brep.Vertices[0];
      hypar0.P1 = par_brep.Vertices[1];
      hypar0.P2 = par_brep.Vertices[2];
      hypar0.P3 = par_brep.Vertices[3];
    }
    else if ((par_startNum % 4 + 4) % 4 == 1)
    {
      hypar0.P0 = par_brep.Vertices[1];
      hypar0.P1 = par_brep.Vertices[2];
      hypar0.P2 = par_brep.Vertices[3];
      hypar0.P3 = par_brep.Vertices[0];
    }
    else if ((par_startNum % 4 + 4) % 4 == 2)
    {
      hypar0.P0 = par_brep.Vertices[2];
      hypar0.P1 = par_brep.Vertices[3];
      hypar0.P2 = par_brep.Vertices[0];
      hypar0.P3 = par_brep.Vertices[1];
    }
    else if ((par_startNum % 4 + 4) % 4 == 3)
    {
      hypar0.P0 = par_brep.Vertices[3];
      hypar0.P1 = par_brep.Vertices[0];
      hypar0.P2 = par_brep.Vertices[1];
      hypar0.P3 = par_brep.Vertices[2];
    }
    else hypar0 = null;
    return hypar0;
  }

  public static Hypar HyparOrientation(Hypar par_hypar, int par_startNum)
  {
    Hypar hypar0 = new Hypar();
    if ((par_startNum % 4 + 4) % 4 == 0)
    {
      hypar0.P0 = par_hypar.P0;
      hypar0.P1 = par_hypar.P1;
      hypar0.P2 = par_hypar.P2;
      hypar0.P3 = par_hypar.P3;
    }
    else if ((par_startNum % 4 + 4) % 4 == 1)
    {
      hypar0.P0 = par_hypar.P1;
      hypar0.P1 = par_hypar.P2;
      hypar0.P2 = par_hypar.P3;
      hypar0.P3 = par_hypar.P0;
    }
    else if ((par_startNum % 4 + 4) % 4 == 2)
    {
      hypar0.P0 = par_hypar.P2;
      hypar0.P1 = par_hypar.P3;
      hypar0.P2 = par_hypar.P0;
      hypar0.P3 = par_hypar.P1;
    }
    else if ((par_startNum % 4 + 4) % 4 == 3)
    {
      hypar0.P0 = par_hypar.P3;
      hypar0.P1 = par_hypar.P0;
      hypar0.P2 = par_hypar.P1;
      hypar0.P3 = par_hypar.P2;
    }
    else hypar0 = null;
    return hypar0;
  }
  public static Hypar HyparGenerator(Hypar hypar0, double k, double angle1, double angle2)
  {
    Hypar hypar1 = new Hypar();
    double tri1_length01, tri1_length12, tri2_length32, tri2_length12;
    Vector3d tri1_vec, tri2_vec, vector12;
    // remap angle
    if (angle1 > 0)
      angle1 = angle1 * (Math.PI - hypar0.getAngle()[1]);
    else
      angle1 = angle1 * hypar0.getAngle()[1];

    if (angle2 > 0)
      angle2 = angle2 * hypar0.getAngle()[2];
    else
      angle2 = angle2 * (Math.PI - hypar0.getAngle()[2]);

    // solve triangle1
    tri1_length01 = k * hypar0.getVector()[0].Length;
    tri1_length12 = tri1_length01 * Math.Sin(angle1) / (Math.Sin(Math.PI - angle1 - hypar0.getAngle()[1]));
    vector12 = hypar0.getVector()[1];
    vector12.Unitize();
    tri1_vec = tri1_length12 * vector12;

    // solve triangle2
    tri2_length32 = k * hypar0.getVector()[2].Length;
    tri2_length12 = tri2_length32 * Math.Sin(angle2) / (Math.Sin(hypar0.getAngle()[2] - angle2));
    vector12 = hypar0.getVector()[1];
    vector12.Unitize();
    tri2_vec = tri2_length12 * vector12;

    //create hypar
    hypar1.P0 = hypar0.P1;
    hypar1.P1 = new Point(hypar0.P1.Location + (k * hypar0.getVector()[0] + tri1_vec));
    hypar1.P2 = new Point(hypar0.P2.Location - (k * hypar0.getVector()[2] - tri2_vec));
    hypar1.P3 = hypar0.P2;
    return hypar1;
  }

  /// <summary>
  /// Hypar generator in edge 12 with abusolute angle value in radius, no remap is included
  /// </summary>
  /// <param name="hypar0">hypar type</param>
  /// <param name="k">extend coefficient</param>
  /// <param name="angle1">angle in line01</param>
  /// <param name="angle2">angle in line32</param>
  /// <returns></returns>
  public static Hypar HyparGenerator_Absolute(Hypar hypar0, double k, double angle1, double angle2)
  {
    Hypar hypar1 = new Hypar();
    double tri1_length01, tri1_length12, tri2_length32, tri2_length12;
    Vector3d tri1_vec, tri2_vec, vector12;

    // solve triangle1
    tri1_length01 = k * hypar0.getVector()[0].Length;
    tri1_length12 = tri1_length01 * Math.Sin(angle1) / (Math.Sin(Math.PI - angle1 - hypar0.getAngle()[1]));
    vector12 = hypar0.getVector()[1];
    vector12.Unitize();
    tri1_vec = tri1_length12 * vector12;

    // solve triangle2
    tri2_length32 = k * hypar0.getVector()[2].Length;
    tri2_length12 = tri2_length32 * Math.Sin(angle2) / (Math.Sin(hypar0.getAngle()[2] - angle2));
    vector12 = hypar0.getVector()[1];
    vector12.Unitize();
    tri2_vec = tri2_length12 * vector12;

    //create hypar
    hypar1.P0 = hypar0.P1;
    hypar1.P1 = new Point(hypar0.P1.Location + (k * hypar0.getVector()[0] + tri1_vec));
    hypar1.P2 = new Point(hypar0.P2.Location - (k * hypar0.getVector()[2] - tri2_vec));
    hypar1.P3 = hypar0.P2;


    return hypar1;
  }
  public static Guid AddAngularDim(Point3d pM, Point3d pA, Point3d pB, string anno, double offset)
  {
    pA = pM + offset * (pA - pM) / (pA.DistanceTo(pM));
    pB = pM + offset * (pB - pM) / (pB.DistanceTo(pM));
    var dimstyle = new DimensionStyle();
    var dim = AngularDimension.Create(dimstyle, new Plane(pM, pA, pB), Vector3d.XAxis,
      pM,
      pA,
      pB,
      0.33 * (pM + pA + pB));
    dim.PlainText = anno;
    return Rhino.RhinoDoc.ActiveDoc.Objects.AddAngularDimension(dim);
  }
  /// <summary>
  /// Hypar generator in edge 23 with abusolute angle value in radius, no remap is included
  /// </summary>
  /// <param name="hypar0">hypar type</param>
  /// <param name="k">extend coefficient</param>
  /// <param name="angle1">angle in line01</param>
  /// <param name="angle2">angle in line32</param>
  /// <returns></returns>
  public static Hypar HyparGenRight_Absolute(Hypar hypar0, double k, double angle1, double angle2)
  {

    Hypar hypar = new Hypar();
    Hypar temphypar = new Hypar();
    hypar.P0 = hypar0.P1;
    hypar.P1 = hypar0.P2;
    hypar.P2 = hypar0.P3;
    hypar.P3 = hypar0.P0;
    temphypar = HyparGenerator_Absolute(hypar, k, -angle2, -angle1);
    hypar.P0 = temphypar.P3;
    hypar.P1 = temphypar.P0;
    hypar.P2 = temphypar.P1;
    hypar.P3 = temphypar.P2;
    return hypar;
  }

  public static Hypar HyparGenRight(Hypar hypar0, double k, double angle1, double angle2)
  {
    Hypar hypar = new Hypar();
    Hypar temphypar = new Hypar();
    hypar.P0 = hypar0.P1;
    hypar.P1 = hypar0.P2;
    hypar.P2 = hypar0.P3;
    hypar.P3 = hypar0.P0;
    temphypar = HyparGenerator(hypar, k, -angle2, -angle1);
    hypar.P0 = temphypar.P3;
    hypar.P1 = temphypar.P0;
    hypar.P2 = temphypar.P1;
    hypar.P3 = temphypar.P2;
    return hypar;
  }
  public static Hypar HyparGenMiddle(Hypar hyparLeft, Hypar hyparRight)
  {
    Hypar tar_Hypar = new Hypar();
    const double extendLength = 10000;
    Line hL23 = new Line(hyparLeft.P2.Location, hyparLeft.P3.Location);
    hL23.Extend(extendLength, extendLength);
    double disA = hL23.DistanceTo(hyparRight.P2.Location, false);
    double disB = hL23.DistanceTo(hyparLeft.P0.Location, false);

    Line hR12 = new Line(hyparRight.P1.Location, hyparRight.P2.Location);
    hR12.Extend(extendLength, extendLength);
    double disC = hR12.DistanceTo(hyparLeft.P2.Location, false);
    double disD = hR12.DistanceTo(hyparRight.P0.Location, false);

    Point pA = new Point(hyparLeft.P2.Location + (disA / disB) * hyparLeft.getVector()[1]);
    Point pB = new Point(hyparRight.P2.Location - (disC / disD) * hyparRight.getVector()[2]);
    Vector3d vecAB = new Vector3d((Vector3d) pB.Location - (Vector3d) pA.Location);

    Vector3d uvecAC = hyparLeft.getVector()[2];
    uvecAC.Unitize();
    Vector3d uvecBC = -hyparRight.getVector()[1];
    uvecBC.Unitize();

    Line lineAC = new Line(pA.Location, pA.Location + uvecAC);
    lineAC.Extend(extendLength, extendLength);
    Line lineBC = new Line(pB.Location, pB.Location + uvecBC);
    lineBC.Extend(extendLength, extendLength);
    double a, b;
    Rhino.Geometry.Intersect.Intersection.LineLine(lineAC, lineBC, out a, out b, 0.01, false);

    Point pCatAC = new Point(lineAC.PointAt(a));
    Point pCatBC = new Point(lineBC.PointAt(b));
    if (pCatAC.Location != pCatBC.Location)
    {
      // throw new ArgumentException("no intersection was found");
    }

            /*Rhino.RhinoDoc.ActiveDoc.Objects.AddPoint(pA.Location);
            Rhino.RhinoDoc.ActiveDoc.Objects.AddPoint(pB.Location);
            Rhino.RhinoDoc.ActiveDoc.Objects.AddPoint(pC.Location);
            Rhino.RhinoDoc.ActiveDoc.Objects.AddLine(lineAC);
            Rhino.RhinoDoc.ActiveDoc.Objects.AddLine(lineBC);*/

    tar_Hypar.P0 = hyparLeft.P3;
    tar_Hypar.P1 = hyparLeft.P2;
    tar_Hypar.P2 = pCatAC;
    tar_Hypar.P3 = hyparRight.P2;

    return tar_Hypar;
  }
}
# ---------- positive_side: C# ----------
    //get hypar data
    Brep inputBrep1 = InputHypar1;
    Brep inputBrep2 = InputHypar2;
    Hypar hyparLeft = Hypar.HyparOrientation(inputBrep1, 0);
    Hypar hyparRight = Hypar.HyparOrientation(inputBrep2, 0);

    //convert to point3d type
    List<Point3d> hL = new List<Point3d>();
    hL.Add(hyparLeft.P0.Location);
    hL.Add(hyparLeft.P1.Location);
    hL.Add(hyparLeft.P2.Location);
    hL.Add(hyparLeft.P3.Location);

    List<Point3d> hR = new List<Point3d>();
    hR.Add(hyparRight.P0.Location);
    hR.Add(hyparRight.P1.Location);
    hR.Add(hyparRight.P2.Location);
    hR.Add(hyparRight.P3.Location);

    //remap point sequence
    var hyparLeft1 = new Hypar();
    var hyparRight1 = new Hypar();
    var hyparLeft2 = new Hypar();
    var hyparRight2 = new Hypar();

    var hL03 = new Vector3d();
    var hL32 = new Vector3d();
    var hR01 = new Vector3d();
    var hR12 = new Vector3d();

    //判断顺逆时针并调整
    for (int p = 0; p <= 3; p++)
    {
      for (int q = 0; q <= 3; q++)
      {
        if (hL[p].Equals(hR[q]))
        {

          //编号顺逆时针判断
          hL03 = (Vector3d) hL[(p % 4 + 4) % 4] - (Vector3d) hL[((p + 1) % 4 + 4) % 4];
          hL32 = (Vector3d) hL[((p - 1) % 4 + 4) % 4] - (Vector3d) hL[(p % 4 + 4) % 4];

          hR01 = (Vector3d) hR[(q % 4 + 4) % 4] - (Vector3d) hR[((q - 1) % 4 + 4) % 4];
          hR12 = (Vector3d) hR[((q + 1) % 4 + 4) % 4] - (Vector3d) hR[(q % 4 + 4) % 4];
          if (Vector3d.Multiply(Vector3d.CrossProduct(hL03, hL32), Vector3d.CrossProduct(hR01, hR12)) > 0)
          {
            hyparLeft.P1 = new Point(hL[3]);
            hyparLeft.P3 = new Point(hL[1]);
          }
        }
      }
    }
    for (int i = 0; i <= 3; i++)
    {
      for (int j = 0; j <= 3; j++)
      {
        if (hL[i].Equals(hR[j]))//公共点判断
        {
          //side a
          hyparLeft1 = Hypar.HyparOrientation(hyparLeft, i - 3);
          hyparRight1 = Hypar.HyparOrientation(hyparRight, j - 1);
          //side b
          hyparLeft2 = Hypar.HyparOrientation(hyparLeft, i - 1);
          hyparRight2 = Hypar.HyparOrientation(hyparRight, j + 1);
          break;
        }
      }
    }

    // hypar generation
    var hypar1 = Hypar.HyparGenMiddle(hyparLeft1, hyparRight1);
    var hypar2 = Hypar.HyparGenMiddle(hyparRight2, hyparLeft2);
    

    // set data
    Hypar1 = NurbsSurface.CreateFromCorners(hypar1.P2.Location, hypar1.P3.Location, hypar1.P0.Location, hypar1.P1.Location);
    
    //DA.SetData("Hypar2", hypar2.HyparSurface());
# ---------- end positive_side ----------
hypargen2plus1 = HyparGen2plus1(InputHypar1=srf_6, InputHypar2=srf_7)
